# Grasshopper definition Tangent circles.ghx (Grasshopper 1.0.7)

construct_point = ConstructPoint(XCoordinate=Slider(0, range=0..50), YCoordinate=Slider(0, range=0..50), ZCoordinate=Slider(0, range=0..50))
construct_point_2 = ConstructPoint(XCoordinate=Slider(30, range=0..50), YCoordinate=Slider(0, range=0..50), ZCoordinate=Slider(0, range=0..50))
circle = Circle(Plane=construct_point, Radius=Slider(11.75, range=0..50))
circle_2 = Circle(Plane=construct_point_2, Radius=Slider(11.75, range=0..50))
